# Dynamo custom node AdicionarMovel.dyf (Dynamo 2.5.0.7460)
# category: Aulas_Sistemas
# packages: Clockwork for Dynamo 2.x 2.3.0

curvas = Input(curvas: var[]..[])
rot = Input(rot: var[]..[])
geometry = Input(geometry: Autodesk.DesignScript.Geometry.Geometry)
boundingBox = Geometry.BoundingBox(geometry=geometry)
properties = Custom[BoundingBox.Properties](boundingBox=boundingBox)  # package Clockwork for Dynamo 2.x; Retrieves the centroid, width, depth and height of a given bounding box
code_block = CodeBlock { 0.02; }
offsetXY = Custom[OffsetXY](curvas=curvas, angulo=rot, w=properties.Width, d=properties.Depth, afastamento=code_block)
profundidade = Input(profundidade: double)
posicao = Input(posicao: double)
pointAtParameter = Surface.PointAtParameter(surface=offsetXY.Surface, u=profundidade, v=posicao)
code_block_2 = CodeBlock(p=pointAtParameter, d=properties.Depth, w=properties.Width, h=properties.Height)
# ---------- code_block_2.designscript (8 lines) ----------
// Area livre da cama: 60cm p/ frente
o = CoordinateSystem.ByOrigin(p);
or = CoordinateSystem.Translate(o,0,-d/2-0.3,0);

al = Rectangle.ByWidthLength(or,w,0.6);
af = Rectangle.ByWidthLength(o,w,d);
h;
Vector.ZAxis();
# ----------------------------------------
extrudeAsSolid = Curve.ExtrudeAsSolid(curve=code_block_2.al, distance=code_block_2.h)
code_block_3 = CodeBlock(x=rot) { 360/4*x; }
rotate = Geometry.Rotate(geometry=extrudeAsSolid, origin=pointAtParameter, axis=code_block_2.out5, degrees=code_block_3)
parede = Input(parede: var)
distanceTo = Geometry.DistanceTo(geometry=rotate, other=parede)
extrudeAsSolid_2 = Curve.ExtrudeAsSolid(curve=code_block_2.af, distance=code_block_2.h)
rotate_2 = Geometry.Rotate(geometry=extrudeAsSolid_2, origin=pointAtParameter, axis=code_block_2.out5, degrees=code_block_3)
distanceTo_2 = Geometry.DistanceTo(geometry=rotate_2, other=parede)
code_block_4 = CodeBlock(num1=distanceTo, num2=distanceTo_2) { num1 < num2; }
eq = Equals(x=distanceTo, y=distanceTo_2)
not_ = Not(x=eq)
and_ = code_block_4 && not_
code_block_5 = CodeBlock { 180; 0; }
if_ = If(test=and_, true=code_block_5.out0, false=code_block_5.out1)
rotate_3 = Geometry.Rotate(geometry=rotate, origin=pointAtParameter, axis=code_block_2.out5, degrees=if_)
code_block_6 = CodeBlock { color1 = Color.ByARGB(50, 255, 50, 50); }
byGeometryColor = Modifiers.GeometryColor.ByGeometryColor(geometry=rotate_3, color=code_block_6)
AL_Cor = Output(byGeometryColor)  # "AL-Cor"
Área_Livre = Output(rotate_3)
rotate_4 = Geometry.Rotate(geometry=rotate_2, origin=pointAtParameter, axis=code_block_2.out5, degrees=if_)
Área_Física = Output(rotate_4)
start = Input(start: Autodesk.DesignScript.Geometry.Point)
add = code_block_3 + if_
mover_Movel = Custom[Mover_Movel](start=start, end=pointAtParameter, geometry=geometry, degrees=add)
code_block_7 = CodeBlock { color1 = Color.ByARGB(255, 100, 255, 255); }
byGeometryColor_2 = Modifiers.GeometryColor.ByGeometryColor(geometry=mover_Movel, color=code_block_7)
AF_Cor = Output(byGeometryColor_2)  # "AF-Cor"
flatten = List.Flatten(list=curvas)
