# Dynamo custom node Mover_Movel.dyf (Dynamo 2.5.0.7460)
# category: Aulas_Sistemas

geometry = Input(geometry: Autodesk.DesignScript.Geometry.Geometry)
start = Input(start: Autodesk.DesignScript.Geometry.Point)
end = Input(end: Autodesk.DesignScript.Geometry.Point)
byTwoPoints = Vector.ByTwoPoints(start=start, end=end)
translate = Geometry.Translate(geometry=geometry, direction=byTwoPoints)
ZAxis = Vector.ZAxis()
degrees = Input(degrees: double)
rotate = Geometry.Rotate(geometry=translate, origin=end, axis=ZAxis, degrees=degrees)
byUnion = Solid.ByUnion(solids=rotate)
byUnion_2 = Solid.ByUnion(solids=byUnion)
Solid = Output(byUnion_2)
