# Dynamo custom node OffsetXY.dyf (Dynamo 2.5.0.7460)
# category: Aulas_Sistemas

curvas = Input(curvas: var[]..[])
flatten = List.Flatten(list=curvas)
angulo = Input(angulo: var[]..[])
w = Input(w: var[]..[])
d = Input(d: var[]..[])
afastamento = Input(afastamento: var[]..[] = 0.1)
code_block = CodeBlock(angulo=angulo, w=w, d=d, afastamento=afastamento) { x = angulo % 2 == 0? w/2 : d/2; y = angulo % 2 == 0? d/2 : w/2; x+afastamento; y+afastamento; }
code_block_2 = CodeBlock(lista=flatten, x=code_block.out2, y=code_block.out3)
# ---------- code_block_2.designscript (6 lines) ----------
vx = Vector.XAxis();
vy = Vector.YAxis();
p0 = Autodesk.Geometry.Translate(lista[0], vx, x);
p1 = Autodesk.Geometry.Translate(lista[1], vy, y);
p2 = Autodesk.Geometry.Translate(lista[2], vx, -x);
p3 = Autodesk.Geometry.Translate(lista[3], vy, -y);
# ----------------------------------------
intersect = Geometry.Intersect(geometry=code_block_2.p0, other=code_block_2.p1)
intersect_2 = Geometry.Intersect(geometry=code_block_2.p0, other=code_block_2.p3)
intersect_3 = Geometry.Intersect(geometry=code_block_2.p2, other=code_block_2.p3)
intersect_4 = Geometry.Intersect(geometry=code_block_2.p1, other=code_block_2.p2)
list_create = List.Create(item0=intersect, item1=intersect_2, item2=intersect_3, item3=intersect_4)
flatten_2 = List.Flatten(list=list_create)
byPerimeterPoints = Surface.ByPerimeterPoints(points=flatten_2)
Surface = Output(byPerimeterPoints)
code_block_3 = CodeBlock(p=flatten_2) { [p[0],p[1],p[2],p[3]]; [p[1],p[2],p[3],p[0]]; }
byStartPointEndPoint = Line.ByStartPointEndPoint(startPoint=code_block_3.out0, endPoint=code_block_3.out1)
list_create_2 = List.Create(item0=byStartPointEndPoint)
byJoinedCurves = PolyCurve.ByJoinedCurves(curves=list_create_2)
code_block_4 = CodeBlock(pc=byJoinedCurves) { pc[0]; }
Linhas = Output(code_block_4)
