# Dynamo graph LeonardoSole_TrabalhoFinal.dyn (Dynamo 2.5.0.7460)
# packages: Clockwork for Dynamo 2.x 2.3.0, GenerativeDesign 1.3.1, GenerativeDesign.Revit 1.3.1

# group: Selecionar ambiente
selecionar_quarto = DSModelRoomSelection()  # 1 picked in the model
selecionar_porta = DSModelFamilyInstanceSelection()  # 1 picked in the model

# group: Quarto
finishes = Custom[Room.Finishes](room=selecionar_quarto)  # package Clockwork for Dynamo 2.x; Returns all room bounding faces and their materials
geometry = Element.Geometry(element=finishes.elements)
flatten = List.Flatten(list=geometry)
remember = Data.Remember(flatten)
byUnion = Solid.ByUnion(solids=remember)
# note: Cria superfície, calcula diagonal e extrai paredes do quarto.
coreBoundary = Room.CoreBoundary(room=selecionar_quarto)
remember_2 = Data.Remember(coreBoundary)
flatten_2 = List.Flatten(list=coreBoundary)
remember_3 = Data.Remember(flatten_2)
length = Curve.Length(curve=remember_3)
code_block = CodeBlock(l=length) { h = Math.Sqrt(l[0]*l[0]+l[1]*l[1]); }
byJoinedCurves = PolyCurve.ByJoinedCurves(curves=remember_2)
remember_4 = Data.Remember(byJoinedCurves)
code_block_2 = CodeBlock(linhas=remember_4)
# ---------- code_block_2.designscript (3 lines) ----------
surface = Surface.ByPatch(linhas);
cor = Color.ByARGB(255, 150, 150, 150);
forma = GeometryColor.ByGeometryColor(surface, cor);
# ----------------------------------------

# group: INPUTS
IN_U3 = DoubleSlider(1, range=0..1 step 0.25)  # graph input
IN_V3 = DoubleSlider(1, range=0..1 step 0.25)  # graph input
IN_Degree3 = DoubleSlider(1, range=0..1 step 1)  # graph input
IN_U2 = DoubleSlider(0, range=0..1 step 0.25)  # graph input
IN_V2 = DoubleSlider(0.75, range=0..1 step 0.25)  # graph input
IN_Degree2 = DoubleSlider(1, range=0..1 step 1)  # graph input
IN_U1 = DoubleSlider(1, range=0..1 step 0.25)  # graph input
IN_V1 = DoubleSlider(0, range=0..1 step 0.25)  # graph input
IN_Degree1 = DoubleSlider(1, range=0..1 step 1)  # graph input

# group: Selecionar móveis
selecionar_comoda = DSModelFamilyInstanceSelection()  # 1 picked in the model
selecionar_cama = DSModelFamilyInstanceSelection()  # 1 picked in the model

# group: Cômoda 2
# note: Posiciona e rotaciona o móvel no ponto desejado, criando áreas livres e áreas totais.
getLocation = Element.GetLocation(element=selecionar_comoda)
remember_5 = Data.Remember(getLocation)
geometry_2 = Element.Geometry(element=selecionar_comoda)
remember_6 = Data.Remember(geometry_2)
byUnion_2 = Solid.ByUnion(solids=remember_6)

adicionarMovel = Custom[AdicionarMovel](parede=byUnion, profundidade=IN_U3, posicao=IN_V3, start=remember_5, geometry=byUnion_2, rot=IN_Degree3, curvas=remember_2)

# group (continued): Cômoda 2
byUnion_3 = Solid.ByUnion(solids=adicionarMovel.Área_Livre)
byUnion_4 = Solid.ByUnion(solids=adicionarMovel.Área_Física)
área_total = CodeBlock(solid1=byUnion_3, solid2=byUnion_4) { lista = [solid1, solid2]; solid3 = Solid.ByUnion(lista); }
exibe_área_física = CodeBlock(exibir=adicionarMovel.AF_Cor) { exibir; }
exibe_área_livre = CodeBlock(exibir=adicionarMovel.AL_Cor) { exibir; }

# group: Cômoda 1
# note: Posiciona e rotaciona o móvel no ponto desejado, criando áreas livres e áreas totais.
getLocation_2 = Element.GetLocation(element=selecionar_comoda)
remember_7 = Data.Remember(getLocation_2)
geometry_3 = Element.Geometry(element=selecionar_comoda)
remember_8 = Data.Remember(geometry_3)
byUnion_5 = Solid.ByUnion(solids=remember_8)

adicionarMovel_2 = Custom[AdicionarMovel](parede=byUnion, profundidade=IN_U2, posicao=IN_V2, start=remember_7, geometry=byUnion_5, rot=IN_Degree2, curvas=remember_2)

# group (continued): Cômoda 1
byUnion_6 = Solid.ByUnion(solids=adicionarMovel_2.Área_Livre)
byUnion_7 = Solid.ByUnion(solids=adicionarMovel_2.Área_Física)
área_total_2 = CodeBlock(solid1=byUnion_6, solid2=byUnion_7) { lista = [solid1, solid2]; solid3 = Solid.ByUnion(lista); }
exibe_área_física_2 = CodeBlock(exibir=adicionarMovel_2.AF_Cor) { exibir; }
exibe_área_livre_2 = CodeBlock(exibir=adicionarMovel_2.AL_Cor) { exibir; }

# group: Cama
# note: Posiciona e rotaciona o móvel no ponto desejado, criando áreas livres e áreas totais.
getLocation_3 = Element.GetLocation(element=selecionar_cama)
remember_9 = Data.Remember(getLocation_3)
geometry_4 = Element.Geometry(element=selecionar_cama)
remember_10 = Data.Remember(geometry_4)
byUnion_8 = Solid.ByUnion(solids=remember_10)
adicionarMovel_3 = Custom[AdicionarMovel](parede=byUnion, profundidade=IN_U1, posicao=IN_V1, start=remember_9, geometry=byUnion_8, rot=IN_Degree1, curvas=remember_2)
byUnion_9 = Solid.ByUnion(solids=adicionarMovel_3.Área_Livre)
byUnion_10 = Solid.ByUnion(solids=adicionarMovel_3.Área_Física)
área_total_3 = CodeBlock(solid1=byUnion_9, solid2=byUnion_10) { lista = [solid1, solid2]; solid3 = Solid.ByUnion(lista); }
exibe_área_física_3 = CodeBlock(exibir=adicionarMovel_3.AF_Cor) { exibir; }
exibe_área_livre_3 = CodeBlock(exibir=adicionarMovel_3.AL_Cor) { exibir; }

# group: Listas de móveis
ATs = List.Create(item0=área_total.solid3, item1=área_total_2.solid3, item2=área_total_3.solid3)
AFs = List.Create(item0=byUnion_4, item1=byUnion_7, item2=byUnion_10)
ALs = List.Create(item0=byUnion_3, item1=byUnion_6, item2=byUnion_9)

# group: Porta
# note: Cria área livre da porta e exibe a folha.
code_block_3 = CodeBlock(elemento=selecionar_porta) { geometria = Elements.Element.Geometry(elemento); tipo = "Solid"; lista = List.RemoveIfNot(geometria, tipo); }
remember_11 = Data.Remember(code_block_3.lista)
folha = CodeBlock(x=remember_11) { List.Slice(x,0,1); x[0].BoundingBox; }
getLocation_4 = Element.GetLocation(element=selecionar_porta)
remember_12 = Data.Remember(getLocation_4)
byOrigin = CoordinateSystem.ByOrigin(origin=remember_12)
code_block_4 = CodeBlock { color1 = Color.ByARGB(160, 120, 65, 14); color2 = Color.ByARGB(30, 255, 100, 100); }
byUnion_11 = Solid.ByUnion(solids=folha.out0)
byGeometryColor = Modifiers.GeometryColor.ByGeometryColor(geometry=byUnion_11, color=code_block_4.color1)

porta_total = CodeBlock(solids=remember_11) { porta = Solid.ByUnion(solids); porta.BoundingBox; }

# group (continued): Porta
code_block_5 = CodeBlock(bbox=folha.out1, pbbox=porta_total.out1, o=byOrigin)
# ---------- code_block_5.designscript (12 lines) ----------
dX = Math.Abs(bbox.MaxPoint.X - bbox.MinPoint.X);
dY = Math.Abs(bbox.MaxPoint.Y - bbox.MinPoint.Y);
h = Math.Abs(bbox.MaxPoint.Z - bbox.MinPoint.Z);
pX = Math.Abs(pbbox.MaxPoint.X - pbbox.MinPoint.X);
pY = Math.Abs(pbbox.MaxPoint.Y - pbbox.MinPoint.Y);
pg = dX>dY?dY/2:dX/2;
lado = dX>dY?dX:dY;
parede = pX>pY?pY/2:pX/2;
tY = dX>dY?lado/2+parede-pg:0;
tX = dX>dY?0:lado/2+parede-pg;
or = CoordinateSystem.Translate(o,tX,tY,0);
Rectangle.ByWidthLength(or,lado,lado);
# ----------------------------------------
extrudeAsSolid = Curve.ExtrudeAsSolid(curve=code_block_5.out11, distance=code_block_5.h)
byGeometryColor_2 = Modifiers.GeometryColor.ByGeometryColor(geometry=extrudeAsSolid, color=code_block_4.color2)

# group: Interseções ÁREAS TOTAIS
# note: Verifica interseções de áreas.
count = List.Count(list=ATs)
doesIntersect = Geometry.DoesIntersect(geometry=ATs, other=ATs, lacing=CrossProduct)
countTrue = List.CountTrue(list=doesIntersect)
eq = count == countTrue
byUnion_12 = Solid.ByUnion(solids=ATs)
list_create = List.Create(item0=byUnion, item1=extrudeAsSolid)
byUnion_13 = Solid.ByUnion(solids=list_create)
doesIntersect_2 = Geometry.DoesIntersect(geometry=byUnion_12, other=byUnion_13)
# note: Interseções de áreas zeram as pontuações.
countFalse = List.CountFalse(list=doesIntersect_2)

# group: Distâncias base
# note: Distâncias limites para cálculo da pontuação.
Q_moveis = List.Count(list=AFs)
code_block_6 = CodeBlock(h=code_block, q_moveis=Q_moveis) { limite_porta = h/q_moveis; limite_moveis = limite_porta/2; }

# group: Distância porta
# note: Verifica se distâncias entre os móveis e a porta é maior do que um limite definido.
distanceTo = Geometry.DistanceTo(geometry=extrudeAsSolid, other=AFs)
gt = distanceTo > code_block_6.limite_porta  # lacing=CrossProduct
flatten_3 = List.Flatten(list=gt)
# note: Quantidade de móveis distantes da porta.
countTrue_2 = List.CountTrue(list=flatten_3)

# group: Distância parede
# note: Verifica se distâncias entre os móveis e a parede é menor do que um limite definido.
distanceTo_2 = Geometry.DistanceTo(geometry=byUnion, other=AFs)
code_block_7 = CodeBlock { limite_parede = 0.02; }
le = distanceTo_2 <= code_block_7
# note: Quantidade de móveis encostados nas paredes.
countTrue_3 = List.CountTrue(list=le)

# group: Distância entre móveis
distanceTo_3 = Geometry.DistanceTo(geometry=AFs, other=AFs, lacing=CrossProduct)
flatten_4 = List.Flatten(list=distanceTo_3)
sort = List.Sort(list=flatten_4)
# note: Verifica se distâncias entre móveis é maior que um limite definido.
count_2 = List.Count(list=AFs)
dropItems = List.DropItems(list=sort, amount=count_2)
code_block_8 = CodeBlock { 2; }
dropEveryNthItem = List.DropEveryNthItem(list=dropItems, n=code_block_8)
gt_2 = dropEveryNthItem > code_block_6.limite_moveis  # lacing=CrossProduct
flatten_5 = List.Flatten(list=gt_2)
# note: Quantidade de móveis distantes um do outro.
countTrue_4 = List.CountTrue(list=flatten_5)

# group: Avaliação
AF = CodeBlock(al=eq, paredes=countFalse)
# ---------- AF.designscript (3 lines) ----------
// intersecao de areas fisicas zera pontuacao
area_livre = al?1:0;
area_livre*paredes;
# ----------------------------------------
avaliacao = CodeBlock(grave=AF.out1, porta=countTrue_2, parede=countTrue_3, moveis=countTrue_4)
# ---------- avaliacao.designscript (4 lines) ----------
dist_porta = grave*porta*porta;
dist_parede = grave*parede*parede;
pontuacao_quarto = (dist_porta+dist_parede)/2;
dist_moveis = grave*moveis*moveis;
# ----------------------------------------
OUT_Quarto = Watch(avaliacao.pontuacao_quarto)  # graph output
OUT_Moveis = Watch(avaliacao.dist_moveis)  # graph output
