# Dynamo custom node Add_Movel.dyf (Dynamo 2.5.0.7460)
# category: Aulas_Sistemas
# adiciona um movel
# packages: Clockwork for Dynamo 2.x 2.3.0, Genius Loci 2021.2.18

element = Input(element: var)
x = Input(x: var[]..[])
code_block = CodeBlock(x=x) { 360/8*x; }
element_setrotation = Custom[Element SetRotation](element=element, degree=code_block)  # frozen; package Genius Loci; Set the angle of the element around its local Z-axis. (Same as the Rotate command in Revit)
curve = Input(curve: Autodesk.DesignScript.Geometry.Curve)
geometry = Input(geometry: var)
boundingBox = Geometry.BoundingBox(geometry=geometry)
properties = Custom[BoundingBox.Properties](boundingBox=boundingBox)  # package Clockwork for Dynamo 2.x; Retrieves the centroid, width, depth and height of a given bounding box
code_block_2 = CodeBlock(w=properties.Width, d=properties.Depth) { offset = w>d?-d/2:-w/2; }
offset = Curve.Offset(curve=curve, distance=code_block_2)
byPatch = Surface.ByPatch(closedCurve=offset)
u = Input(u: double)
v = Input(v: double)
pointAtParameter = Surface.PointAtParameter(surface=byPatch, u=u, v=v)
element_setlocation = Custom[Element SetLocation](element=element_setrotation, location=pointAtParameter)  # package Genius Loci; Modify the location of the given element. (Same as the Move command in Revit.) Works for point/ line/ sketch based elements, view-specific elements, groups and link instances.
Element = Output(element_setlocation)
code_block_3 = CodeBlock(p=pointAtParameter, d=properties.Depth, w=properties.Width, h=properties.Height)
# ---------- code_block_3.designscript (8 lines) ----------
// Area livre da cama: 60cm p/ frente
o = CoordinateSystem.ByOrigin(p);
or = CoordinateSystem.Translate(o,0,d/2+0.3,0);

al = Rectangle.ByWidthLength(or,w,0.6);
af = Rectangle.ByWidthLength(o,w,d);
h;
Vector.ZAxis();
# ----------------------------------------
extrudeAsSolid = Curve.ExtrudeAsSolid(curve=code_block_3.al, distance=code_block_3.h)
rotate = Geometry.Rotate(geometry=extrudeAsSolid, origin=pointAtParameter, axis=code_block_3.out5, degrees=code_block)
AL = Output(rotate)
extrudeAsSolid_2 = Curve.ExtrudeAsSolid(curve=code_block_3.af, distance=code_block_3.h)
rotate_2 = Geometry.Rotate(geometry=extrudeAsSolid_2, origin=pointAtParameter, axis=code_block_3.out5, degrees=code_block)
AF = Output(rotate_2)
code_block_4 = CodeBlock { 50; 255; }
byARGB = Color.ByARGB(a=code_block_4.out0, r=code_block_4.out1, g=code_block_4.out1, b=code_block_4.out1)
byGeometryColor = Modifiers.GeometryColor.ByGeometryColor(geometry=rotate, color=byARGB)
GeometryColor = Output(byGeometryColor)
