# Dynamo custom node Closest Level.dyf (Dynamo 1.3.4.6666)
# category: GeniusLoci.Level
# Return the closest level below the given element.

element = Input()
python_script = Python(IN[0]=element)
# ---------- python_script.python (50 lines) ----------
#Alban de Chasteigner 2020
#twitter : @geniusloci_bim
#geniusloci.bim@gmail.com
#https://github.com/albandechasteigner/GeniusLociForDynamo

import clr
clr.AddReference("RevitAPI")
import Autodesk
from Autodesk.Revit.DB import Level, FilteredElementCollector, HostObjectUtils, UV

clr.AddReference("RevitServices")
import RevitServices
from RevitServices.Persistence import DocumentManager
doc = DocumentManager.Instance.CurrentDBDocument

items = UnwrapElement(IN[0]) if isinstance(IN[0],list) else [UnwrapElement(IN[0])]
search = []

levels = FilteredElementCollector(doc).OfClass(Level).ToElements()
sortedLevels = sorted(levels,key=lambda level : level.Elevation, reverse=True)

def closest(sortedLevels, number): 
	try:
		result= min([level for level in sortedLevels if level.Elevation <= number], key=lambda x: abs(x.Elevation-number))
	except:
		result= min([level for level in sortedLevels if level.Elevation >= number], key=lambda x: abs(x.Elevation-number))
	return result
	
for item in items:
	#Thanks to the Clockwork package
	if hasattr(item, "Location") :
		loc = item.Location
		if loc:
			# line-based elements (e.g. walls)
			if loc.ToString() == 'Autodesk.Revit.DB.LocationCurve':
				elementZ=loc.Curve.Evaluate(0.5, True).Z
			# point-based elements (e.g. most loadable families)
			elif loc.ToString() == 'Autodesk.Revit.DB.LocationPoint':
				elementZ=loc.Point.Z
			# some elements have a location property but don't return curves or points
			elif loc.ToString() == 'Autodesk.Revit.DB.Location':
				try:
					for ref in HostObjectUtils.GetBottomFaces(item):
						uv = UV(0.5,0.5)
						elementZ = item.GetGeometryObjectFromReference(ref).Evaluate(uv).Z
				except: elementZ = None
		else: elementZ = None
		search.append(closest(sortedLevels, elementZ))

OUT = search
# ----------------------------------------
Level = Output(python_script)
