# Dynamo custom node Compound Surfaces References.dyf (Dynamo 1.3.4.6666)
# category: GeniusLoci.Reference
# Retrieves Top, Bottom and Side Faces, Materials, and references of a roof, floor, ceiling or wall if applicable.
# Also works with linked element.

element = Input()  # Roof, floor, ceiling or wall
surfaces = Python(IN[0]=element)
# ---------- surfaces.python (73 lines) ----------
#Alban de Chasteigner 2019
#twitter : @geniusloci_bim
#geniusloci.bim@gmail.com
import clr
clr.AddReference('RevitAPI')
from Autodesk.Revit.DB import *
from Autodesk.Revit.DB.Structure import *

# Import ToDSType  (bool) extension method
clr.AddReference("RevitNodes")
import Revit
# Adds ToProtoType, ToRevitType geometry conversion extension methods to objects
clr.ImportExtensions(Revit.GeometryConversion)
# Import Element wrapper extension methods
clr.ImportExtensions(Revit.Elements)
from Revit.Elements import *

elements = UnwrapElement(IN[0])
if not hasattr(elements, '__iter__'):
	elements = [elements]
	
topFaces,bottomFaces,extFaces,intFaces,topMats,bottomMats,extMats,intMats=[],[],[],[],[],[],[],[]
elementsRef=ReferenceArray()

for element in elements:
	doc=element.Document
	try:
		top = HostObjectUtils.GetTopFaces(element)
		for t in top:
			topFace = element.GetGeometryObjectFromReference(t)
			topFaces.append(topFace.ToProtoType())
			topmat=doc.GetElement(topFace.MaterialElementId)
			topMats.append(topmat)
			elementsRef.Append(t)
	except:
		topFaces.append(None)
		topMats.append(None)
	try:
		bottom = HostObjectUtils.GetBottomFaces(element)
		for b in bottom:
			bottomFace = element.GetGeometryObjectFromReference(b)
			bottomFaces.append(bottomFace.ToProtoType())
			bottommat=doc.GetElement(bottomFace.MaterialElementId)
			bottomMats.append(bottommat)
			elementsRef.Append(b)
	except:
		bottomFaces.append(None)
		bottomMats.append(None)
	try:
		extSide = HostObjectUtils.GetSideFaces(element,ShellLayerType.Exterior)
		for e in extSide:
			extFace = element.GetGeometryObjectFromReference(e)
			extFaces.append(extFace.ToProtoType())
			extmat=doc.GetElement(extFace.MaterialElementId)
			extMats.append(extmat)
			elementsRef.Append(e)
	except:
		extFaces.append(None)
		extMats.append(None)		
	try:
		intSide = HostObjectUtils.GetSideFaces(element,ShellLayerType.Interior)
		for i in intSide:
			intFace = element.GetGeometryObjectFromReference(i)
			intFaces.append(intFace.ToProtoType())
			intmat=doc.GetElement(intFace.MaterialElementId)
			intMats.append(intmat)
			elementsRef.Append(i)
	except:
		intFaces.append(None)
		intMats.append(None)
		
if isinstance(IN[0], (list)): OUT = topFaces,topMats,bottomFaces,bottomMats,extFaces,extMats,intFaces,intMats,elementsRef
else: OUT = topFaces[0],topMats[0],bottomFaces[0],bottomMats[0],extFaces[0],extMats[0],intFaces[0],intMats[0],elementsRef
# ----------------------------------------
code_block = CodeBlock(x=surfaces) { x[0]; x[1]; x[2]; x[3]; x[4]; x[5]; x[6]; x[7]; x[8]; }
Top_Surface = Output(code_block.out0)
Top_Material = Output(code_block.out1)
Bottom_Surface = Output(code_block.out2)
Bottom_Material = Output(code_block.out3)
Exterior_Side_Surface = Output(code_block.out4)
Exterior_Side_Material = Output(code_block.out5)
Interior_Side_Surface = Output(code_block.out6)
Interior_Side_Material = Output(code_block.out7)
References = Output(code_block.out8)
