# Dynamo custom node Create Shared Parameter.dyf (Dynamo 1.3.4.6666)
# category: GeniusLoci.Parameter
# Create shared parameters in the shared parameter file and then add it to the project.
# It is possible to use an existing GUID to recreate an identical shared parameter in a new SP file. Or use the GUID input to simply add the shared parameters to the project.
# Inspired by archilab

ParameterName = Input()  # String
GroupName = Input()  # String. Group of the shared parameter
ParameterType = Input()  # String or DB.ParameterType
ParameterGroup = Input()  # String or DB.BuiltInParameterGroup
IsInstance = Input(IsInstance:bool[]..[]=true)  # Is instance parameter, otherwise it's a type parameter
IsVisible = Input(IsVisible:bool[]..[]=true)
GUID = Input(GUID:var[]..[]=null)  # Optional input. String or System Guid
category = Input()
python_script = Python(IN[0]=ParameterName, IN[1]=GroupName, IN[2]=ParameterType, IN[3]=ParameterGroup, IN[4]=IsInstance, IN[5]=IsVisible, IN[6]=GUID, IN[7]=category)
# ---------- python_script.python (131 lines) ----------
#Inspired by an archilab node
#Copyright(c) 2015, Konrad Sobon
# @arch_laboratory, http://archi-lab.net

import clr
clr.AddReference("RevitAPI")
import Autodesk
from Autodesk.Revit.DB import *

# Import DocumentManager and TransactionManager
clr.AddReference("RevitServices")
import RevitServices
from RevitServices.Persistence import DocumentManager
from RevitServices.Transactions import TransactionManager
doc = DocumentManager.Instance.CurrentDBDocument
uiapp = DocumentManager.Instance.CurrentUIApplication
app = uiapp.Application

# Import ToDSType(bool) extension method
clr.AddReference("RevitNodes")
import Revit
clr.ImportExtensions(Revit.Elements)

import System
from System.Collections.Generic import List
from System import Guid

_paramName = IN[0]
_groupName = IN[1]
parameterType = IN[2]
parameterGroup = IN[3]
_instance = IN[4]
_visible = IN[5]
guid = IN[6]
_categories = IN[7]

if not hasattr(_categories, '__iter__'):
	_categories = [_categories]

if isinstance(parameterGroup, basestring):
	exec("_paramGroup = BuiltInParameterGroup.%s" % parameterGroup)
else:
	_paramGroup = parameterGroup
	
if isinstance(parameterType, basestring):
	exec("_paramType = ParameterType.%s" % parameterType)
else :
	_paramType = parameterType

if isinstance(guid, basestring):
	_guid = Guid(guid)
else :
	_guid = guid

def ParamBindingExists(_doc, _paramName, _paramType):
	map = doc.ParameterBindings
	iterator = map.ForwardIterator()
	iterator.Reset()
	while iterator.MoveNext():
		if iterator.Key != None and iterator.Key.Name == _paramName and iterator.Key.ParameterType == _paramType:
			paramExists = True
			break
		else:
			paramExists = False
	return paramExists

def RemoveParamBinding(_doc, _paramName, _paramType):
	map = doc.ParameterBindings
	iterator = map.ForwardIterator()
	iterator.Reset()
	while iterator.MoveNext():
		if iterator.Key != None and iterator.Key.Name == _paramName and iterator.Key.ParameterType == _paramType:
			definition = iterator.Key
			break
	message = None
	if definition != None:
		map.Remove(definition)
		message = "Success"
	return message

def addParam(doc, _paramName, _paramType, _visible, _instance, _guid, _groupName, _paramGroup):
	message = None
	if ParamBindingExists(doc, _paramName, _paramType):
		if not RemoveParamBinding(doc, _paramName, _paramType) == "Success":
			message = "Param Binding Not Removed Successfully"
		else:
			message = None
			
	group = app.OpenSharedParameterFile().Groups.get_Item(_groupName)
	if group == None:
		group = file.Groups.Create(_groupName)
	if group.Definitions.Contains(group.Definitions.Item[_paramName]):
		_def = group.Definitions.Item[_paramName]
	else:
		opt = ExternalDefinitionCreationOptions(_paramName, _paramType)
		opt.Visible = _visible
		if _guid != None:
			opt.GUID = _guid 
		_def = group.Definitions.Create(opt)
	param = doc.ParameterBindings.Insert(_def, bind, _paramGroup)
	return message
	
TransactionManager.Instance.EnsureInTransaction(doc)
try:
	file = app.OpenSharedParameterFile()
except:
	message = "No Shared Parameter file found."
	pass

builtInCategory=[]
for _category in _categories :
	builtInCategory.append(System.Enum.ToObject(BuiltInCategory, _category.Id))
	cats=app.Create.NewCategorySet()
	for builtIn in builtInCategory :
		cats.Insert(doc.Settings.Categories.get_Item(builtIn))
if _instance:
	bind = app.Create.NewInstanceBinding(cats)
else:
	bind = app.Create.NewTypeBinding(cats)

if isinstance(_paramName, list) and _guid:
	for i, j, k, l, m, n in zip(_paramName, _paramType, _visible, _instance, _guid, _paramGroup):
		message = addParam(doc, i, j, k, l, m, _groupName, n)
else:
	message = addParam(doc, _paramName, _paramType, _visible, _instance, _guid, _groupName, _paramGroup)
TransactionManager.Instance.TransactionTaskDone()

if message == None:
	OUT = "Success"
else:
	OUT = message
# ----------------------------------------
Result = Output(python_script)
