# Dynamo custom node Document Units.dyf (Dynamo 1.3.4.6666)
# category: GeniusLoci.Document
# Retrieves the unit types of a given document.

docOrRevitLinkInstance = Input(docOrRevitLinkInstance : var[] = null)  # Use only if you want to query a linked model
python_script = Python(IN[0]=docOrRevitLinkInstance)
# ---------- python_script.python (38 lines) ----------
#Alban de Chasteigner 2020
#twitter : @geniusloci_bim
#geniusloci.bim@gmail.com
#https://github.com/albandechasteigner/GeniusLociForDynamo

import clr
clr.AddReference("RevitServices")
import RevitServices 
from RevitServices.Persistence import DocumentManager

clr.AddReference('RevitAPI')
import Autodesk
from Autodesk.Revit.DB import Document, RevitLinkInstance, UnitType, UnitSymbolType, LabelUtils

inputdoc = UnwrapElement(IN[0]) if isinstance(IN[0],list) else [UnwrapElement(IN[0])][0]

unitTypes = [UnitType.UT_Angle, UnitType.UT_Area, UnitType.UT_Length,UnitType.UT_MassDensity, UnitType.UT_Slope, UnitType.UT_Volume, UnitType.UT_Currency]
results=[]

if inputdoc == None:
	doc = DocumentManager.Instance.CurrentDBDocument
elif isinstance(inputdoc,Document):
	doc = inputdoc
elif isinstance(inputdoc,RevitLinkInstance):
	doc = inputdoc.GetLinkDocument()
else: doc = DocumentManager.Instance.CurrentDBDocument

for unitType in unitTypes:
	formatOption = doc.GetUnits().GetFormatOptions(unitType)
	dispUnit = formatOption.DisplayUnits
	symType = formatOption.UnitSymbol
	if symType == UnitSymbolType.UST_NONE:
		dispSym = None
	else:
		dispSym = LabelUtils.GetLabelFor(symType)
	results.append([dispUnit,dispSym])
	
OUT = results
# ----------------------------------------
code_block = CodeBlock(x=python_script) { x[0]; x[1]; x[2]; x[3]; x[4]; x[5]; x[6]; }
Angle = Output(code_block.out0)
Area = Output(code_block.out1)
Length = Output(code_block.out2)
MassDensity = Output(code_block.out3)
Slope = Output(code_block.out4)
Volume = Output(code_block.out5)
Currency = Output(code_block.out6)
