# Dynamo custom node Elements From Linked File in Space.dyf (Dynamo 1.3.4.6666)
# category: GeniusLoci.Room
# This node will check what elements from a linked model are inside of any of the spaces in the current model.
# Based on an archilab node

elements = Input()
Spaces = Input()
LinkInstance = Input()
python_script = Python(IN[0]=elements, IN[1]=Spaces, IN[2]=LinkInstance)
# ---------- python_script.python (87 lines) ----------
#Copyright(c) 2015, Konrad Sobon
# @arch_laboratory, http://archi-lab.net

# This code is based on Family.InRoom node originally created
# by Peter Kompolschek and published on Dynamo blog. Big thanks 
# to Peter for sharing his work so graciously.

import clr
import sys
clr.AddReference('ProtoGeometry')
from Autodesk.DesignScript.Geometry import *

pyt_path = r'C:\Program Files (x86)\IronPython 2.7\Lib'
sys.path.append(pyt_path)

# Import ToDSType(bool) extension method
clr.AddReference("RevitNodes")
import Revit
clr.ImportExtensions(Revit.Elements)

# Import DocumentManager and TransactionManager
clr.AddReference("RevitServices")
import RevitServices
from RevitServices.Persistence import DocumentManager
from RevitServices.Transactions import TransactionManager

# Import RevitAPI
clr.AddReference("RevitAPI")
import Autodesk
from Autodesk.Revit.DB import *

doc = DocumentManager.Instance.CurrentDBDocument
uiapp = DocumentManager.Instance.CurrentUIApplication
app = uiapp.Application

rvtLink = UnwrapElement(IN[2])
transform = rvtLink.GetTotalTransform()

def TryGetSpace(family, phase):
	try:
		inSpace = family.Space[phase]
	except:
		inSpace = None
		pass
	return inSpace

def FamiliesInSpace(_space, _families, _transform, _doc):
	outList = []
	for family in _families:
		location = family.Location
		if type(location) == LocationPoint:
			pt = _transform.OfPoint(location.Point)
		else:
			pt = _transform.OfPoint(location.Curve.Evaluate(0.5, True))
		if _space.IsPointInSpace(pt):
			outList.append(family)
		else:
			for phase in _doc.Phases:
				inSpace = TryGetSpace(family, phase)
				if inSpace != None and inSpace.ToDSType(True).Name == _space.ToDSType(True).Name:
					outList.append(family)
	return outList

try:
	errorReport = None
	families = []
	for i in IN[0]:
		families.append(UnwrapElement(i))
	
	spaces = []
	for i in IN[1]:
		if UnwrapElement(i).Area > 0:
			spaces.append(UnwrapElement(i))
	
	outData = [[] for i in range(len(spaces))]
	for index, space in enumerate(spaces):
		outData[index].extend(FamiliesInSpace(space, families, transform, doc))
except:
	# if error accurs anywhere in the process catch it
	import traceback
	errorReport = traceback.format_exc()

#Assign your output to the OUT variable
if errorReport == None:
	OUT = outData
else:
	OUT = errorReport
# ----------------------------------------
Elements = Output(python_script)
