# Dynamo custom node Group Lines by Orthogonality.dyf (Dynamo 1.3.4.6666)
# category: GeniusLoci.Geometry
# Group vertical, horizontal and oblique lines together. Works with dynamo lines et MEPCurves elements (duct, pipe, cable tray and conduit).

lines = Input()  # Dynamo line or MEPCurves (Duct, pipe...)
filter_lines = Python(IN[0]=lines)
# ---------- filter_lines.python (31 lines) ----------
#Alban de Chasteigner 2020
#twitter : @geniusloci_bim
#geniusloci.bim@gmail.com

import clr
clr.AddReference('RevitAPI')
import Autodesk
from Autodesk.Revit.DB import *

clr.AddReference('RevitNodes')
import Revit
clr.ImportExtensions(Revit.GeometryConversion)
from Revit.Elements import *

elements = UnwrapElement(IN[0]) if isinstance(IN[0],list) else [UnwrapElement(IN[0])]
	
horizontal,vertical, slope =[],[],[]

for element in elements:
	if hasattr(element, "Explode"):
		curve=element.ToRevitType()
	elif hasattr(element, "Location") and element.Location.ToString() == 'Autodesk.Revit.DB.LocationCurve':
		curve=element.Location.Curve
		if round(curve.GetEndPoint(0).Z,2) == round(curve.GetEndPoint(1).Z,2):
			horizontal.append(element)
		elif round(curve.GetEndPoint(0).X,2) == round(curve.GetEndPoint(1).X,2) and round(curve.GetEndPoint(0).Y,2) == round(curve.GetEndPoint(1).Y,2):
			vertical.append(element)
		else: slope.append(element)
	
if isinstance(IN[0], (list)): OUT = vertical,horizontal,slope
else: OUT = vertical[0],horizontal[0],slope[0]
# ----------------------------------------
code_block = CodeBlock(x=filter_lines) { x[0]; x[1]; x[2]; }
Vertical = Output(code_block.out0)
Horizontal = Output(code_block.out1)
Sloping = Output(code_block.out2)
