# Dynamo custom node Material Change Image and Edit it.dyf (Dynamo 1.3.4.6666)
# category: GeniusLoci.Material
# Works only in Revit 2018.1 and later.
# The material must already have an assigned texture.
# Changes the image and edit its properties.
# (All inputs are optional)

material = Input()
filePath = Input(filePath:var[]..[]=null)
Offset_X = Input(Offset_X:var[]..[]=null)  # Number
Offset_Y = Input(Offset_Y:var[]..[]=null)  # Number
Rotation = Input(Rotation:var[]..[]=null)  # Number within the range of 0..360
Scale_Widht = Input(Scale_Widht:var[]..[]=null)  # Number. Minimum of "0.01
Scale_Height = Input(Scale_Height:var[]..[]=null)  # Number. Minimum of "0.01
Scale_Lock = Input(Scale_Lock:var[]..[]=null)  # Boolean
material_change_image_and_edit = Python(IN[0]=material, IN[1]=filePath, IN[2]=Offset_X, IN[3]=Offset_Y, IN[4]=Rotation, IN[5]=Scale_Widht, IN[6]=Scale_Height, IN[7]=Scale_Lock)
# ---------- material_change_image_and_edit.python (76 lines) ----------
#Inspired by Boris Shafiro from Autodesk
#https://apidocs.co/apps/revit/2019/2e09391a-6aec-f47f-a4e6-bf354bb8629f.htm

import clr
clr.AddReference('RevitAPI')
from Autodesk.Revit.DB import *
from Autodesk.Revit.DB.Visual import *

clr.AddReference('RevitServices')
import RevitServices
from RevitServices.Persistence import DocumentManager
from RevitServices.Transactions import TransactionManager
doc = DocumentManager.Instance.CurrentDBDocument

def toList(obj):
    if hasattr(obj, '__iter__'): return obj
    else: return [obj]
    
mats = toList(UnwrapElement(IN[0]))
paths = toList(IN[1])
offsetX = IN[2]
offsetY = IN[3]
angle = IN[4]
scaleWidht = IN[5]
scaleHeight = IN[6]
scaleLock = IN[7]

UIunit = Document.GetUnits(doc).GetFormatOptions(UnitType.UT_Length).DisplayUnits

for mat, path in zip(mats, paths):
	assetElem = doc.GetElement(mat.AppearanceAssetId)
	TransactionManager.Instance.EnsureInTransaction(doc)
	with Visual.AppearanceAssetEditScope(assetElem.Document) as editScope:
		editableAsset = editScope.Start(assetElem.Id)
		
		if path == None:
			pass
		else:	
			BitMapLocation = editableAsset[UnifiedBitmap.UnifiedbitmapBitmap] 
			#AssetProperty String Object
			BitMapLocation.Value = path
		if offsetX == None:
			pass
		else:
			BitmapOffsetX = editableAsset[UnifiedBitmap.TextureRealWorldOffsetX]
			BitmapOffsetX.Value = UnitUtils.Convert(offsetX, UIunit, DisplayUnitType.DUT_DECIMAL_INCHES)
		if offsetY == None:
			pass
		else:
			BitmapOffsetY = editableAsset[UnifiedBitmap.TextureRealWorldOffsetY]
			BitmapOffsetY.Value = UnitUtils.Convert(offsetY, UIunit, DisplayUnitType.DUT_DECIMAL_INCHES)
		if angle == None:
			pass
		else:
			TextureWAngle = editableAsset[UnifiedBitmap.TextureWAngle]
			TextureWAngle.Value = angle
		if scaleWidht == None:
			pass
		else:		
			BitmapScaleX = editableAsset[UnifiedBitmap.TextureRealWorldScaleX]
			BitmapScaleX.Value = UnitUtils.Convert(scaleWidht, UIunit, DisplayUnitType.DUT_CENTIMETERS)
		if scaleHeight == None:
			pass
		else:
			BitmapScaleY = editableAsset[UnifiedBitmap.TextureRealWorldScaleY]
			BitmapScaleY.Value = UnitUtils.Convert(scaleHeight, UIunit, DisplayUnitType.DUT_CENTIMETERS)
		if scaleLock == None:
			pass
		else:		
			Scalelock = editableAsset[UnifiedBitmap.TextureScaleLock]
			Scalelock.Value = scaleLock

		editScope.Commit(IFailuresPreprocessor)
	TransactionManager.Instance.TransactionTaskDone()

OUT = mats
# ----------------------------------------
Material = Output(material_change_image_and_edit)
