# Dynamo graph Trabalho.dyn (Dynamo 2.5.0.7460)
# packages: Clockwork for Dynamo 2.x 2.3.0, GenerativeDesign 1.3.1, GenerativeDesign.Revit 1.3.1

# group: Quarto
selecionar_quarto = DSModelRoomSelection()  # 1 picked in the model
coreBoundary = Room.CoreBoundary(room=selecionar_quarto)
byJoinedCurves = PolyCurve.ByJoinedCurves(curves=coreBoundary)
remember = Data.Remember(byJoinedCurves)
code_block = CodeBlock { 3; }
extrudeAsSolid = Curve.ExtrudeAsSolid(curve=remember, distance=code_block)
remember_2 = Data.Remember(extrudeAsSolid)
byUnion = Solid.ByUnion(solids=remember_2)
remember_3 = Data.Remember(coreBoundary)
code_block_2 = CodeBlock(p=remember_3)
# ---------- code_block_2.designscript (4 lines) ----------
//calcular diagonal do quarto
a = p[0][0].Length;
b = p[0][1].Length;
d = Math.Sqrt(a*a+b*b);
# ----------------------------------------
finishes = Custom[Room.Finishes](room=selecionar_quarto)  # package Clockwork for Dynamo 2.x; Returns all room bounding faces and their materials
geometry = Element.Geometry(element=finishes.elements)
remember_4 = Data.Remember(geometry)
byUnion_2 = Solid.ByUnion(solids=remember_4)
byUnion_3 = Solid.ByUnion(solids=byUnion_2)
byUnion_4 = Solid.ByUnion(solids=byUnion_3)
byPatch = Surface.ByPatch(closedCurve=remember)

# group: Porta
selecionar_porta = DSModelFamilyInstanceSelection()  # 1 picked in the model
geometry_2 = Custom[Element.Geometry+](element=selecionar_porta)  # package Clockwork for Dynamo 2.x; Returns Dynamo AND native Revit geometry of a given element
getLocation = Element.GetLocation(element=selecionar_porta)
code_block_3 = CodeBlock { 100; 255; }
byARGB = Color.ByARGB(a=code_block_3.out0, r=code_block_3.out1, g=code_block_3.out0, b=code_block_3.out0)

remember_5 = Data.Remember(geometry_2.dynamoGeometry)
code_block_4 = CodeBlock(x=remember_5) { List.Slice(x,0,1); x[0]; }

# group (continued): Porta
boundingBox = Geometry.BoundingBox(geometry=code_block_4.out1)

byUnion_5 = Solid.ByUnion(solids=remember_5)
boundingBox_2 = Geometry.BoundingBox(geometry=byUnion_5)
remember_6 = Data.Remember(getLocation)

# group (continued): Porta
byOrigin = CoordinateSystem.ByOrigin(origin=remember_6)
code_block_5 = CodeBlock(bbox=boundingBox, pbbox=boundingBox_2, o=byOrigin)
# ---------- code_block_5.designscript (12 lines) ----------
dX = Math.Abs(bbox.MaxPoint.X - bbox.MinPoint.X);
dY = Math.Abs(bbox.MaxPoint.Y - bbox.MinPoint.Y);
h = Math.Abs(bbox.MaxPoint.Z - bbox.MinPoint.Z);
pX = Math.Abs(pbbox.MaxPoint.X - pbbox.MinPoint.X);
pY = Math.Abs(pbbox.MaxPoint.Y - pbbox.MinPoint.Y);
pg = dX>dY?dY/2:dX/2;
lado = dX>dY?dX:dY;
parede = pX>pY?pY/2:pX/2;
tY = dX>dY?lado/2+parede-pg:0;
tX = dX>dY?0:lado/2+parede-pg;
or = CoordinateSystem.Translate(o,tX,tY,0);
Rectangle.ByWidthLength(or,lado,lado);
# ----------------------------------------
extrudeAsSolid_2 = Curve.ExtrudeAsSolid(curve=code_block_5.out11, distance=code_block_5.h)

byUnion_6 = Solid.ByUnion(solids=code_block_4.out0)

# group (continued): Porta
byGeometryColor = Modifiers.GeometryColor.ByGeometryColor(geometry=byUnion_6, color=byARGB)

code_block_6 = CodeBlock { color1 = Color.ByARGB(255, 100, 255, 255); }

# group: Cama
IN_U1 = DoubleSlider(0, range=0..1 step 0.01)  # graph input
IN_V1 = DoubleSlider(0.82, range=0..1 step 0.01)  # graph input
IN_Degree1 = DoubleSlider(5, range=0..7 step 1)  # graph input
selecionar_cama = DSModelFamilyInstanceSelection()  # 1 picked in the model
geometry_3 = Element.Geometry(element=selecionar_cama)
remember_7 = Data.Remember(geometry_3)
byUnion_7 = Solid.ByUnion(solids=remember_7)
add_Movel = Custom[Add_Movel](u=IN_U1, v=IN_V1, curve=remember, x=IN_Degree1, geometry=byUnion_7)  # adiciona um movel
byUnion_8 = Solid.ByUnion(solids=add_Movel.AL)
byUnion_9 = Solid.ByUnion(solids=add_Movel.AF)
code_block_7 = CodeBlock(exibir=add_Movel.GeometryColor) { exibir; }
code_block_8 = CodeBlock(exibir=add_Movel.AF) { exibir; }

getLocation_2 = Element.GetLocation(element=selecionar_cama)
remember_8 = Data.Remember(getLocation_2)
mover_Movel = Custom[Mover_Movel](start=remember_8, end=add_Movel.Location, geometry=byUnion_7, degrees=add_Movel.Rotation)

# group (continued): Cama
byGeometryColor_2 = Modifiers.GeometryColor.ByGeometryColor(geometry=mover_Movel, color=code_block_6)

code_block_9 = CodeBlock { color1 = Color.ByARGB(255, 100, 255, 255); }

# group: Comoda
IN_U2 = DoubleSlider(0.98, range=0..1 step 0.01)  # graph input
IN_V2 = DoubleSlider(1, range=0..1 step 0.01)  # graph input
IN_Degree2 = DoubleSlider(0, range=0..7 step 1)  # graph input
selecionar_comoda = DSModelFamilyInstanceSelection()  # 1 picked in the model
geometry_4 = Element.Geometry(element=selecionar_comoda)
remember_9 = Data.Remember(geometry_4)
byUnion_10 = Solid.ByUnion(solids=remember_9)
add_Movel_2 = Custom[Add_Movel](u=IN_U2, v=IN_V2, curve=remember, x=IN_Degree2, geometry=byUnion_10)
byUnion_11 = Solid.ByUnion(solids=add_Movel_2.AF)
byUnion_12 = Solid.ByUnion(solids=add_Movel_2.AL)
code_block_10 = CodeBlock(exibir=add_Movel_2.GeometryColor) { exibir; }
code_block_11 = CodeBlock(exibir=add_Movel_2.AF) { exibir; }

# group: Testes AL-AF
difference = Solid.Difference(solid=byUnion, other=byUnion_11)
intersect = Geometry.Intersect(geometry=difference, other=byUnion_8)
volume = Solid.Volume(solid=byUnion_8)
difference_2 = Solid.Difference(solid=byUnion, other=byUnion_9)
intersect_2 = Geometry.Intersect(geometry=difference_2, other=byUnion_12)
byUnion_13 = Solid.ByUnion(solids=intersect_2)
volume_2 = Solid.Volume(solid=byUnion_13)
volume_3 = Solid.Volume(solid=byUnion_12)

byUnion_14 = Solid.ByUnion(solids=intersect)

# group (continued): Testes AL-AF
volume_4 = Solid.Volume(solid=byUnion_14)

# group: Testes AL
list_create = List.Create(item0=byUnion_12, item1=byUnion_8)
byUnion_15 = Solid.ByUnion(solids=list_create)
volume_5 = Solid.Volume(solid=byUnion_15)
code_block_12 = CodeBlock { 0; }
intersect_3 = Geometry.Intersect(geometry=byUnion_8, other=byUnion_12)
volume_6 = Solid.Volume(solid=intersect_3)
isEmpty = List.IsEmpty(list=intersect_3)
code_block_13 = CodeBlock(list_true=code_block_12, list_false=volume_6, test=isEmpty) { seq[0] = list_true; seq[1] = list_false; seq[test ? 0 : 1]; }

# group: Distancia moveis
list_create_2 = List.Create(item0=byUnion_11)
distanceTo = Geometry.DistanceTo(geometry=list_create_2, other=byUnion_9)
average = Math.Average(numbers=distanceTo)

# group: Distancia porta
list_create_3 = List.Create(item0=byUnion_11, item1=byUnion_9)
distanceTo_2 = Geometry.DistanceTo(geometry=extrudeAsSolid_2, other=list_create_3)

# group: Distancia parede
list_create_4 = List.Create(item0=byUnion_11, item1=byUnion_9)
distanceTo_3 = Geometry.DistanceTo(geometry=byUnion_4, other=list_create_4)

# group: Testes AF
list_create_5 = List.Create(item0=byUnion_11)
doesIntersect = Geometry.DoesIntersect(geometry=list_create_5, other=byUnion_9)
allFalse = List.AllFalse(list=doesIntersect)
list_create_6 = List.Create(item0=byUnion_11, item1=byUnion_9)
byUnion_16 = Solid.ByUnion(solids=list_create_6)
list_create_7 = List.Create(item0=byUnion_4, item1=extrudeAsSolid_2)
byUnion_17 = Solid.ByUnion(solids=list_create_7)
doesIntersect_2 = Geometry.DoesIntersect(geometry=byUnion_16, other=byUnion_17)
countFalse = List.CountFalse(list=doesIntersect_2)
code_block_14 = CodeBlock(moveis=allFalse, paredes=countFalse)
# ---------- code_block_14.designscript (3 lines) ----------
// intersecao de areas fisicas zera pontuacao
m = moveis?1:0;
m*paredes;
# ----------------------------------------

# group: Avaliacao
avaliacao = CodeBlock(s2=volume_4, s1=volume, s4=volume_2, s3=volume_3, alt=volume_5, ali=code_block_13.out2, d=average, m=code_block_2.d, p=distanceTo_2, r=distanceTo_3, grave=code_block_14.out1)
# ---------- avaliacao.designscript (8 lines) ----------
// area livre ocupada
f1 = s2?s2/s1:0;
f2 = s4?s4/s3:0;
al = (alt - ali)/alt;
// distancias
dm = d/m;
dp = Math.Sum((p-r)/m);
pontos = grave*(dp+f1+f2+dm+al);
# ----------------------------------------
out_pontos_max = Watch(avaliacao.pontos)  # graph output

getLocation_3 = Element.GetLocation(element=selecionar_comoda)
remember_10 = Data.Remember(getLocation_3)
mover_Movel_2 = Custom[Mover_Movel](start=remember_10, end=add_Movel_2.Location, geometry=byUnion_10, degrees=add_Movel_2.Rotation)

# group (continued): Comoda
byGeometryColor_3 = Modifiers.GeometryColor.ByGeometryColor(geometry=mover_Movel_2, color=code_block_9)
